# Grasshopper definition GrasshopperTests.gh (Grasshopper 1.0.7)
# plug-ins: Pterodactyl, Brontosaurus, Megarachne

calendar = Calendar()

# ----
# Vector To Graph Part
number_slider = Slider(5, range=0..10)
panel = Panel("VectorToGraphPartMilimeters_VectorTrue_DeconstructIsDirected")
pt = ConstructPoint(XCoordinate=Slider(4, range=0..10), YCoordinate=number_slider, ZCoordinate=0)
vec = VectorXYZ(XComponent=Slider(2, range=0..10), YComponent=Slider(3, range=0..10), ZComponent=0)  # -> Vector, Length
pt_2 = ConstructPoint(XCoordinate=Slider(4, range=0..10), YCoordinate=Slider(5, range=0..10), ZCoordinate=0)
vec_2 = VectorXYZ(XComponent=Slider(2, range=0..10), YComponent=Slider(3, range=0..10), ZComponent=0)  # -> Vector, Length
vector_to_graph_part = VectorToGraphPart(Vector=vec.Vector, Point=pt, IsDirected=Toggle(True))
vector_to_graph_part_2 = VectorToGraphPart(Vector=vec_2.Vector, Point=pt_2, IsDirected=Toggle(True))
deconstruct_graph_part = DeconstructGraphPart(GraphPart=vector_to_graph_part)  # -> Vertices, Edge, IsDirected, Weight
txt = Text("""Graph Part
Is Directed: True
Edge Weight: 3.60555127546399""")
divide = DivideCurve(Curve=deconstruct_graph_part.Edge, Count=10, Kinks=False)  # -> Points, Tangents, Parameters
pt_3 = Point([Point(4, 5, 0), Point(6, 8, 0)])
assert = Assert(TestNames="VectorToGraphPartMilimeters_VectorTrue_String", Expected=txt, Actual=vector_to_graph_part_2)  # -> Result, FailedInfo
bool = Boolean(True)
num = Number(3.605551275)
pt_4 = Point([Point(4, 5, 0), Point(4.2, 5.3, 0), Point(4.4, 5.6, 0), Point(4.6, 5.9, 0), Point(4.8, 6.2, 0), Point(5, 6.5, 0), Point(5.2, 6.8, 0), Point(5.4, 7.1, 0), Point(5.6, 7.4, 0), Point(5.8, 7.7, 0), Point(6, 8, 0)])
assert_point_list = AssertPointList(
    TestName="VectorToGraphPartMilimeters_VectorTrue_DeconstructVertices",
    ExpectedPointList=pt_3,
    ActualPointList=deconstruct_graph_part.Vertices,
    Tolerance="0.0001")  # -> Result, FailedInfo
assert_2 = Assert(TestNames=panel, Expected=bool, Actual=deconstruct_graph_part.IsDirected)  # -> Result, FailedInfo
assert_3 = Assert(TestNames="VectorToGraphPartMilimeters_VectorTrue_DeconstructWeight", Expected=num, Actual=deconstruct_graph_part.Weight)  # -> Result, FailedInfo
assert_point_list_2 = AssertPointList(
    TestName="VectorToGraphPartMilimeters_VectorTrue_DeconstructEdges",
    ExpectedPointList=pt_4,
    ActualPointList=divide.Points,
    Tolerance="0.0001")  # -> Result, FailedInfo
entwine = Entwine(
    Branch00=assert.Result,
    Branch01=assert_point_list.Result,
    Branch02=assert_point_list_2.Result,
    Branch03=assert_2.Result,
    Branch04=assert_3.Result,
    FlattenInputs=True)  # -> flatten(Result)

# ----
# Two Points To Graph Part
number_slider_2 = Slider(3, range=0..10)
panel_2 = Panel("TwoPointsToGraphPartMilimeters_TwoPointsTrue_DeconstructVertices")
panel_3 = Panel("TwoPointsToGraphPartMilimeters_TwoPointsTrue_DeconstructIsDirected")
panel_4 = Panel("TwoPointsToGraphPartMilimeters_TwoPointsTrue_DeconstructEdges")
pt_5 = ConstructPoint(XCoordinate=Slider(5, range=0..10), YCoordinate=number_slider_2, ZCoordinate=0)
pt_6 = ConstructPoint(XCoordinate=0, YCoordinate=0, ZCoordinate=0)
pt_7 = ConstructPoint(XCoordinate=Slider(10, range=0..10), YCoordinate=Slider(3, range=0..10), ZCoordinate=0)
pt_8 = ConstructPoint(XCoordinate=0, YCoordinate=0, ZCoordinate=0)
panel_5 = Panel("TwoPointsToGraphPartMilimeters_TwoPointsTrue_DeconstructWeight")
two_points_to_graph_part = TwoPointsToGraphPart(PointA=pt_6, PointB=pt_5, IsDirected=True)
two_points_to_graph_part_2 = TwoPointsToGraphPart(PointA=pt_8, PointB=pt_7, IsDirected=Toggle(False))
txt_2 = Text("""Graph Part
Is Directed: True
Edge Weight: 5.8309518948453""")
deconstruct_graph_part_2 = DeconstructGraphPart(GraphPart=two_points_to_graph_part_2)  # -> Vertices, Edge, IsDirected, Weight
assert_4 = Assert(TestNames="TwoPointsToGraphPartMilimeters_TwoPointsTrue_String", Expected=txt_2, Actual=two_points_to_graph_part)  # -> Result, FailedInfo
divide_2 = DivideCurve(Curve=deconstruct_graph_part_2.Edge, Count=10, Kinks=False)  # -> Points, Tangents, Parameters
pt_9 = Point([Point(0, 0, 0), Point(10, 3, 0)])
bool_2 = Boolean(False)
num_2 = Number(10.44030651)
pt_10 = Point([Point(0, 0, 0), Point(1, 0.3, 0), Point(2, 0.6, 0), Point(3, 0.9, 0), Point(4, 1.2, 0), Point(5, 1.5, 0), Point(6, 1.8, 0), Point(7, 2.1, 0), Point(8, 2.4, 0), Point(9, 2.7, 0), Point(10, 3, 0)])
assert_point_list_3 = AssertPointList(TestName=panel_2, ExpectedPointList=pt_9, ActualPointList=deconstruct_graph_part_2.Vertices, Tolerance="0.0001")  # -> Result, FailedInfo
assert_5 = Assert(TestNames=panel_3, Expected=bool_2, Actual=deconstruct_graph_part_2.IsDirected)  # -> Result, FailedInfo
assert_6 = Assert(TestNames=panel_5, Expected=num_2, Actual=deconstruct_graph_part_2.Weight)  # -> Result, FailedInfo
assert_point_list_4 = AssertPointList(TestName=panel_4, ExpectedPointList=pt_10, ActualPointList=divide_2.Points, Tolerance="0.0001")  # -> Result, FailedInfo
entwine_2 = Entwine(
    Branch00=assert_4.Result,
    Branch01=assert_point_list_3.Result,
    Branch02=assert_point_list_4.Result,
    Branch03=assert_5.Result,
    Branch04=assert_6.Result,
    FlattenInputs=True)  # -> flatten(Result)

# ----
# Curve To Graph Part
panel_6 = Panel("CurveToGraphPartMilimeters_NurbsCurveTrue_DeconstructVertices")
nurbs = NurbsCurve(
    Vertices=[Point(-23.10995343, -7.195870574, 0), Point(-6.749057302, 4.935678258, 0), Point(9.834436056, 5.492171323, 0), Point(21.74338766, -9.310544224, 0), Point(31.31506839, 2.487108769, 0)],
    Degree=3,
    Periodic=False)  # -> Curve, Length, Domain
nurbs_2 = NurbsCurve(
    Vertices=[Point(-23.10995343, -7.195870574, 0), Point(-6.749057302, 4.935678258, 0), Point(9.834436056, 5.492171323, 0), Point(21.74338766, -9.310544224, 0), Point(31.31506839, 2.487108769, 0)],
    Degree=3,
    Periodic=False)  # -> Curve, Length, Domain
nurbs_3 = NurbsCurve(
    Vertices=[Point(-23.10995343, -7.195870574, 0), Point(-6.749057302, 4.935678258, 0), Point(9.834436056, 5.492171323, 0), Point(21.74338766, -9.310544224, 0), Point(31.31506839, 2.487108769, 0)],
    Degree=3,
    Periodic=False)  # -> Curve, Length, Domain
panel_7 = Panel("CurveToGraphPartMilimeters_NurbsCurveFalse_DeconstructIsDirected")
nurbs_4 = NurbsCurve(
    Vertices=[Point(-23.10995343, -7.195870574, 0), Point(-6.749057302, 4.935678258, 0), Point(9.834436056, 5.492171323, 0), Point(21.74338766, -9.310544224, 0), Point(31.31506839, 2.487108769, 0)],
    Degree=3,
    Periodic=False)  # -> Curve, Length, Domain
panel_8 = Panel("CurveToGraphPartMilimeters_NurbsCurveTrue_DeconstructIsDirected")
panel_9 = Panel("CurveToGraphPartMilimeters_NurbsCurveTrue_DeconstructWeight")
cir = Circle(Plane=PlaneXY(0, 0, 0), Radius=1)
crv = Curve(nurbs.Curve)
crv_2 = Curve(nurbs_2.Curve)
crv_3 = Curve(nurbs_3.Curve)
crv_4 = Curve(nurbs_4.Curve)
curve_to_graph_part = CurveToGraphPart(Curve=crv, IsDirected=Toggle(False))
curve_to_graph_part_2 = CurveToGraphPart(Curve=crv_2, IsDirected=Toggle(True))
curve_to_graph_part_3 = CurveToGraphPart(Curve=crv_3, IsDirected=Toggle(True))
curve_to_graph_part_4 = CurveToGraphPart(Curve=cir, IsDirected=True)
curve_to_graph_part_5 = CurveToGraphPart(Curve=crv_4, IsDirected=Toggle(False))
txt_3 = Text("""Graph Part
Is Directed: False
Edge Weight: 61.1190340271855""")
txt_4 = Text("""Graph Part
Is Directed: True
Edge Weight: 61.1190340271855""")
deconstruct_graph_part_3 = DeconstructGraphPart(GraphPart=curve_to_graph_part_3)  # -> Vertices, Edge, IsDirected, Weight
deconstruct_graph_part_4 = DeconstructGraphPart(GraphPart=curve_to_graph_part_4)  # -> Vertices, Edge, IsDirected, Weight
# Naming convencion:
# ComponentNameUnits_Input_Output
assert_7 = Assert(TestNames="CurveToGraphPartMilimeters_NurbsCurveFalse_String", Expected=txt_3, Actual=curve_to_graph_part)  # -> Result, FailedInfo
assert_8 = Assert(TestNames="CurveToGraphPartMilimeters_NurbsCurveTrue_String", Expected=txt_4, Actual=curve_to_graph_part_2)  # -> Result, FailedInfo
deconstruct_graph_part_5 = DeconstructGraphPart(GraphPart=curve_to_graph_part_5)  # -> Vertices, Edge, IsDirected, Weight
divide_3 = DivideCurve(Curve=deconstruct_graph_part_3.Edge, Count=10, Kinks=False)  # -> Points, Tangents, Parameters
pt_11 = Point([Point(-23.10995343, -7.195870574, 0), Point(31.31506839, 2.487108769, 0)])
divide_4 = DivideCurve(Curve=deconstruct_graph_part_4.Edge, Count=10, Kinks=False)  # -> Points, Tangents, Parameters
bool_3 = Boolean(True)
pt_12 = Point([Point(-23.10995343, -7.195870574, 0), Point(-18.10725183, -3.686083312, 0), Point(-12.87478231, -0.5310599797, 0), Point(-7.331270421, 2.031000878, 0), Point(-1.418094952, 3.516607478, 0), Point(4.650486706, 3.159345084, 0), Point(10.26149537, 0.7897934307, 0), Point(15.52763009, -2.31038664, 0), Point(21.3516931, -3.926966628, 0), Point(26.9782872, -1.796066674, 0), Point(31.31506839, 2.487108769, 0)])
num_3 = Number(61.11903403)
pt_13 = Point([Point(1, 0, 0), Point(1, 0, 0)])
assert_point_list_5 = AssertPointList(TestName=panel_6, ExpectedPointList=pt_11, ActualPointList=deconstruct_graph_part_3.Vertices, Tolerance="0.0001")  # -> Result, FailedInfo
pt_14 = Point([Point(1, 0, 0), Point(0.8090169933, 0.5877852537, 0), Point(0.3090169582, 0.9510565281, 0), Point(-0.3090169866, 0.9510565188, 0), Point(-0.809016997, 0.5877852487, 0), Point(-1, 0, 0), Point(-0.8090169933, -0.5877852537, 0), Point(-0.3090169582, -0.9510565281, 0), Point(0.3090169866, -0.9510565188, 0), Point(0.809016997, -0.5877852487, 0)])
bool_4 = Boolean(False)
assert_9 = Assert(TestNames=panel_8, Expected=bool_3, Actual=deconstruct_graph_part_3.IsDirected)  # -> Result, FailedInfo
assert_10 = Assert(TestNames=panel_9, Expected=num_3, Actual=deconstruct_graph_part_3.Weight)  # -> Result, FailedInfo
assert_point_list_6 = AssertPointList(
    TestName="CurveToGraphPartMilimeters_NurbsCurveTrue_DeconstructEdges",
    ExpectedPointList=pt_12,
    ActualPointList=divide_3.Points,
    Tolerance="0.0001")  # -> Result, FailedInfo
assert_point_list_7 = AssertPointList(
    TestName="CurveToGraphPartMilimeters_Circle_DeconstructVertices",
    ExpectedPointList=pt_13,
    ActualPointList=deconstruct_graph_part_4.Vertices,
    Tolerance="0.0001")  # -> Result, FailedInfo
assert_11 = Assert(TestNames=panel_7, Expected=bool_4, Actual=deconstruct_graph_part_5.IsDirected)  # -> Result, FailedInfo
assert_point_list_8 = AssertPointList(
    TestName="CurveToGraphPartMilimeters_Circle_DeconstructEdges",
    ExpectedPointList=pt_14,
    ActualPointList=divide_4.Points,
    Tolerance="0.0001")  # -> Result, FailedInfo
entwine_3 = Entwine(
    Branch00=assert_7.Result,
    Branch01=assert_8.Result,
    Branch02=assert_point_list_5.Result,
    Branch03=assert_point_list_6.Result,
    Branch04=assert_9.Result,
    Branch05=assert_10.Result,
    Branch06=assert_11.Result,
    Branch07=assert_point_list_7.Result,
    Branch08=assert_point_list_8.Result,
    FlattenInputs=True)  # -> flatten(Result)

# ----
# Create Graph
number_slider_3 = Slider(10, range=0..10)
number_slider_4 = Slider(5, range=0..10)
pt_15 = ConstructPoint(XCoordinate=0, YCoordinate=0, ZCoordinate=0)
pt_16 = ConstructPoint(XCoordinate=number_slider_3, YCoordinate=0, ZCoordinate=0)
pt_17 = ConstructPoint(XCoordinate=0, YCoordinate=0, ZCoordinate=0)
pt_18 = ConstructPoint(XCoordinate=Slider(10, range=0..10), YCoordinate=0, ZCoordinate=0)
toggle = BooleanToggle(True)
toggle_2 = BooleanToggle(True)
two_points_to_graph_part_3 = TwoPointsToGraphPart(PointA=pt_15, PointB=pt_16, IsDirected=Toggle(True))
pt_19 = ConstructPoint(XCoordinate=0, YCoordinate=0, ZCoordinate=0)
pt_20 = ConstructPoint(XCoordinate=Slider(10, range=0..10), YCoordinate=0, ZCoordinate=0)
pt_21 = ConstructPoint(XCoordinate=0, YCoordinate=0, ZCoordinate=0)
pt_22 = ConstructPoint(XCoordinate=Slider(10, range=0..10), YCoordinate=Slider(5, range=0..10), ZCoordinate=0)
pt_23 = ConstructPoint(XCoordinate=0, YCoordinate=0, ZCoordinate=0)
pt_24 = ConstructPoint(XCoordinate=Slider(10, range=0..10), YCoordinate=0, ZCoordinate=0)
pt_25 = ConstructPoint(XCoordinate=0, YCoordinate=number_slider_4, ZCoordinate=0)
pt_26 = ConstructPoint(XCoordinate=Slider(10, range=0..10), YCoordinate=number_slider_4, ZCoordinate=0)
two_points_to_graph_part_4 = TwoPointsToGraphPart(PointA=pt_17, PointB=pt_18, IsDirected=Toggle(False))
toggle_3 = BooleanToggle(True)
two_points_to_graph_part_5 = TwoPointsToGraphPart(PointA=pt_21, PointB=pt_22, IsDirected=toggle)
two_points_to_graph_part_6 = TwoPointsToGraphPart(PointA=pt_25, PointB=pt_26, IsDirected=toggle_2)
two_points_to_graph_part_7 = TwoPointsToGraphPart(PointA=pt_19, PointB=pt_20, IsDirected=toggle)
two_points_to_graph_part_8 = TwoPointsToGraphPart(PointA=pt_23, PointB=pt_24, IsDirected=toggle_2)
pt_27 = ConstructPoint(XCoordinate=0, YCoordinate=0, ZCoordinate=0)
pt_28 = ConstructPoint(XCoordinate=Slider(10, range=0..10), YCoordinate=0, ZCoordinate=0)
pt_29 = ConstructPoint(XCoordinate=0, YCoordinate=0, ZCoordinate=0)
pt_30 = ConstructPoint(XCoordinate=Slider(5, range=0..10), YCoordinate=Slider(5, range=0..10), ZCoordinate=0)
create_graph = CreateGraph(GraphParts=two_points_to_graph_part_3, Tolerance=0.0001)
create_graph_2 = CreateGraph(GraphParts=two_points_to_graph_part_4, Tolerance=0.0001)
deconstruct_graph = DeconstructGraph(Graph=create_graph_2)  # -> GraphArray, Vertices, Edges, AdjacencyList
deconstruct_graph_2 = DeconstructGraph(Graph=create_graph)  # -> GraphArray, Vertices, Edges, AdjacencyList
two_points_to_graph_part_9 = TwoPointsToGraphPart(PointA=pt_29, PointB=pt_30, IsDirected=toggle_3)
two_points_to_graph_part_10 = TwoPointsToGraphPart(PointA=pt_28, PointB=pt_30, IsDirected=toggle_3)
two_points_to_graph_part_11 = TwoPointsToGraphPart(PointA=pt_27, PointB=pt_28, IsDirected=toggle_3)
crv_5 = Curve(deconstruct_graph_2.Edges)
crv_6 = Curve(deconstruct_graph.Edges)
panel_10 = Panel(deconstruct_graph_2.AdjacencyList)
panel_11 = Panel(deconstruct_graph.AdjacencyList)
create_graph_3 = CreateGraph(GraphParts=[two_points_to_graph_part_7, two_points_to_graph_part_5], Tolerance=0.0001)
deconstruct_graph_3 = DeconstructGraph(Graph=create_graph_3)  # -> GraphArray, Vertices, Edges, AdjacencyList
crv_7 = Curve(deconstruct_graph_3.Edges)
panel_12 = Panel(deconstruct_graph_3.AdjacencyList)
create_graph_4 = CreateGraph(GraphParts=[two_points_to_graph_part_8, two_points_to_graph_part_6], Tolerance=0.0001)
deconstruct_graph_4 = DeconstructGraph(Graph=create_graph_4)  # -> GraphArray, Vertices, Edges, AdjacencyList
divide_5 = DivideCurve(Curve=crv_7, Count=10, Kinks=False)  # -> flatten(Points), Tangents, Parameters
txt_5 = Text("""Graph
Vertices: 2
Edges: 1""")
divide_6 = DivideCurve(Curve=crv_6, Count=10, Kinks=False)  # -> flatten(Points), Tangents, Parameters
divide_7 = DivideCurve(Curve=crv_5, Count=10, Kinks=False)  # -> Points, Tangents, Parameters
txt_6 = Text("""Graph
Vertices: 2
Edges: 2""")
panel_13 = Panel(deconstruct_graph_2.GraphArray)
panel_14 = Panel(deconstruct_graph_3.GraphArray)
txt_7 = Text("0;1")
txt_8 = Text(["0;1", "0;2"])
panel_15 = Panel(deconstruct_graph.GraphArray)
txt_9 = Text("""Graph
Vertices: 3
Edges: 2""")
txt_10 = Text(["1;", ""])
txt_11 = Text(["1;2;", "", ""])
crv_8 = Curve(deconstruct_graph_4.Edges)
txt_12 = Text(["0;1", "1;0"])
pt_31 = Point([Point(0, 0, 0), Point(10, 0, 0), Point(10, 5, 0)])
txt_13 = Text("""Graph
Vertices: 4
Edges: 2""")
pt_32 = Point([Point(0, 0, 0), Point(10, 0, 0)])
txt_14 = Text(["1;", "0;"])
pt_33 = Point([Point(0, 0, 0), Point(10, 0, 0)])
pt_34 = Point([Point(0, 0, 0), Point(1, 0, 0), Point(2, 0, 0), Point(3, 0, 0), Point(4, 0, 0), Point(5, 0, 0), Point(6, 0, 0), Point(7, 0, 0), Point(8, 0, 0), Point(9, 0, 0), Point(10, 0, 0)])
pt_35 = Point([Point(0, 0, 0), Point(1, 0, 0), Point(2, 0, 0), Point(3, 0, 0), Point(4, 0, 0), Point(5, 0, 0), Point(6, 0, 0), Point(7, 0, 0), Point(8, 0, 0), Point(9, 0, 0), Point(10, 0, 0), Point(0, 0, 0), Point(1, 0.5, 0), Point(2, 1, 0), Point(3, 1.5, 0), Point(4, 2, 0), Point(5, 2.5, 0), Point(6, 3, 0), Point(7, 3.5, 0), Point(8, 4, 0), Point(9, 4.5, 0), Point(10, 5, 0)])
panel_16 = Panel(deconstruct_graph_4.AdjacencyList)
pt_36 = Point([Point(0, 0, 0), Point(1, 0, 0), Point(2, 0, 0), Point(3, 0, 0), Point(4, 0, 0), Point(5, 0, 0), Point(6, 0, 0), Point(7, 0, 0), Point(8, 0, 0), Point(9, 0, 0), Point(10, 0, 0), Point(10, 0, 0), Point(9, 0, 0), Point(8, 0, 0), Point(7, 0, 0), Point(6, 0, 0), Point(5, 0, 0), Point(4, 0, 0), Point(3, 0, 0), Point(2, 0, 0), Point(1, 0, 0), Point(0, 0, 0)])
assert_12 = Assert(TestNames="CreateGraphMilimeters_1GraphPart_String", Expected=txt_5, Actual=create_graph)  # -> Result, FailedInfo
assert_13 = Assert(TestNames="CreateGraphMilimeters_1GraphPartUndirected_String", Expected=txt_6, Actual=create_graph_2)  # -> Result, FailedInfo
divide_8 = DivideCurve(Curve=crv_8, Count=10, Kinks=False)  # -> flatten(Points), Tangents, Parameters
create_graph_5 = CreateGraph(GraphParts=[two_points_to_graph_part_11, two_points_to_graph_part_9, two_points_to_graph_part_10], Tolerance=0.0001)
deconstruct_graph_5 = DeconstructGraph(Graph=create_graph_5)  # -> GraphArray, Vertices, Edges, AdjacencyList
crv_9 = Curve(deconstruct_graph_5.Edges)
panel_17 = Panel(deconstruct_graph_5.AdjacencyList)
divide_9 = DivideCurve(Curve=crv_9, Count=10, Kinks=False)  # -> flatten(Points), Tangents, Parameters
assert_list = AssertList(TestName="CreateGraphMilimeters_2GraphParts_GraphArray", ExpectedList=txt_8, ActualList=panel_14)  # -> Result, FailedInfo
assert_point_list_9 = AssertPointList(
    TestName="CreateGraphMilimeters_2GraphParts_Edge",
    ExpectedPointList=pt_35,
    ActualPointList=divide_5.Points,
    Tolerance="0.0001")  # -> Result, FailedInfo
assert_point_list_10 = AssertPointList(
    TestName="CreateGraphMilimeters_2GraphParts_Vertices",
    ExpectedPointList=pt_31,
    ActualPointList=deconstruct_graph_3.Vertices,
    Tolerance="0.0001")  # -> Result, FailedInfo
assert_point_list_11 = AssertPointList(
    TestName="CreateGraphMilimeters_1GraphPart_Edge",
    ExpectedPointList=pt_34,
    ActualPointList=divide_7.Points,
    Tolerance="0.0001")  # -> Result, FailedInfo
assert_list_2 = AssertList(TestName="CreateGraphMilimeters_2GraphParts_AdjacencyList", ExpectedList=txt_11, ActualList=panel_12)  # -> Result, FailedInfo
assert_point_list_12 = AssertPointList(
    TestName="CreateGraphMilimeters_1GraphPart_Vertices",
    ExpectedPointList=pt_32,
    ActualPointList=deconstruct_graph_2.Vertices,
    Tolerance="0.0001")  # -> Result, FailedInfo
assert_14 = Assert(TestNames="CreateGraphMilimeters_1GraphPart_GraphArray", Expected=txt_7, Actual=panel_13)  # -> Result, FailedInfo
assert_list_3 = AssertList(TestName="CreateGraphMilimeters_1GraphPart_AdjacencyList", ExpectedList=txt_10, ActualList=panel_10)  # -> Result, FailedInfo
assert_15 = Assert(TestNames="CreateGraphMilimeters_2GraphParts_String", Expected=txt_9, Actual=create_graph_3)  # -> Result, FailedInfo
panel_18 = Panel(deconstruct_graph_5.GraphArray)
assert_list_4 = AssertList(TestName="CreateGraphMilimeters_1GraphPartUndirected_GraphArray", ExpectedList=txt_12, ActualList=panel_15)  # -> Result, FailedInfo
assert_point_list_13 = AssertPointList(
    TestName="CreateGraphMilimeters_1GraphPartUndirected_Edge",
    ExpectedPointList=pt_36,
    ActualPointList=divide_6.Points,
    Tolerance="0.0001")  # -> Result, FailedInfo
assert_point_list_14 = AssertPointList(
    TestName="CreateGraphMilimeters_1GraphPartUndirected_Vertices",
    ExpectedPointList=pt_33,
    ActualPointList=deconstruct_graph.Vertices,
    Tolerance="0.0001")  # -> Result, FailedInfo
assert_list_5 = AssertList(TestName="CreateGraphMilimeters_1GraphPartUndirected_AdjacencyList", ExpectedList=txt_14, ActualList=panel_11)  # -> Result, FailedInfo
txt_15 = Text(["0;1", "0;2", "1;2"])
assert_16 = Assert(TestNames="CreateGraphMilimeters_2SeparateGraphParts_String", Expected=txt_13, Actual=create_graph_4)  # -> Result, FailedInfo
txt_16 = Text(["1;2;", "2;", ""])
pt_37 = Point([Point(0, 0, 0), Point(10, 0, 0), Point(5, 5, 0)])
panel_19 = Panel(deconstruct_graph_4.GraphArray)
pt_38 = Point([Point(0, 0, 0), Point(1, 0, 0), Point(2, 0, 0), Point(3, 0, 0), Point(4, 0, 0), Point(5, 0, 0), Point(6, 0, 0), Point(7, 0, 0), Point(8, 0, 0), Point(9, 0, 0)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])
txt_17 = Text(["0;1", "2;3"])
txt_18 = Text(["1;", "", "3;", ""])
pt_39 = Point([Point(0, 0, 0), Point(10, 0, 0), Point(0, 5, 0), Point(10, 5, 0)])
pt_40 = Point([Point(0, 0, 0), Point(1, 0, 0), Point(2, 0, 0), Point(3, 0, 0), Point(4, 0, 0), Point(5, 0, 0), Point(6, 0, 0), Point(7, 0, 0), Point(8, 0, 0), Point(9, 0, 0), Point(10, 0, 0), Point(0, 5, 0), Point(1, 5, 0), Point(2, 5, 0), Point(3, 5, 0), Point(4, 5, 0), Point(5, 5, 0), Point(6, 5, 0), Point(7, 5, 0), Point(8, 5, 0), Point(9, 5, 0), Point(10, 5, 0)])
txt_19 = Text("""Graph
Vertices: 3
Edges: 3""")
assert_point_list_15 = AssertPointList(
    TestName="CreateGraphMilimeters_Triangle_Vertices",
    ExpectedPointList=pt_37,
    ActualPointList=deconstruct_graph_5.Vertices,
    Tolerance="0.0001")  # -> Result, FailedInfo
assert_list_6 = AssertList(TestName="CreateGraphMilimeters_Triangle_GraphArray", ExpectedList=txt_15, ActualList=panel_18)  # -> Result, FailedInfo
assert_point_list_16 = AssertPointList(
    TestName="CreateGraphMilimeters_Triangle_Edge",
    ExpectedPointList=pt_38,
    ActualPointList=divide_9.Points,
    Tolerance="0.0001")  # -> Result, FailedInfo
assert_list_7 = AssertList(TestName="CreateGraphMilimeters_Triangle_AdjacencyList", ExpectedList=txt_16, ActualList=panel_17)  # -> Result, FailedInfo
assert_list_8 = AssertList(TestName="CreateGraphMilimeters_2SeparateGraphParts_GraphArray", ExpectedList=txt_17, ActualList=panel_19)  # -> Result, FailedInfo
assert_point_list_17 = AssertPointList(
    TestName="CreateGraphMilimeters_2SeparateGraphParts_Edge",
    ExpectedPointList=pt_40,
    ActualPointList=divide_8.Points,
    Tolerance="0.0001")  # -> Result, FailedInfo
assert_point_list_18 = AssertPointList(
    TestName="CreateGraphMilimeters_2SeparateGraphParts_Vertices",
    ExpectedPointList=pt_39,
    ActualPointList=deconstruct_graph_4.Vertices,
    Tolerance="0.0001")  # -> Result, FailedInfo
assert_list_9 = AssertList(TestName="CreateGraphMilimeters_2SeparateGraphParts_AdjacencyList", ExpectedList=txt_18, ActualList=panel_16)  # -> Result, FailedInfo
assert_17 = Assert(TestNames="CreateGraphMilimeters_Triangle_String", Expected=txt_19, Actual=create_graph_5)  # -> Result, FailedInfo
entwine_4 = Entwine(
    Branch00=assert_13.Result,
    Branch01=assert_list_4.Result,
    Branch02=assert_point_list_14.Result,
    Branch03=assert_point_list_13.Result,
    Branch04=assert_list_5.Result,
    FlattenInputs=True)  # -> flatten(Result)
entwine_5 = Entwine(
    Branch00=assert_15.Result,
    Branch01=assert_list.Result,
    Branch02=assert_point_list_10.Result,
    Branch03=assert_point_list_9.Result,
    Branch04=assert_list_2.Result,
    FlattenInputs=True)  # -> flatten(Result)
entwine_6 = Entwine(
    Branch00=assert_12.Result,
    Branch01=assert_14.Result,
    Branch02=assert_point_list_12.Result,
    Branch03=assert_point_list_11.Result,
    Branch04=assert_list_3.Result,
    FlattenInputs=True)  # -> flatten(Result)
entwine_7 = Entwine(
    Branch00=assert_16.Result,
    Branch01=assert_list_8.Result,
    Branch02=assert_point_list_18.Result,
    Branch03=assert_point_list_17.Result,
    Branch04=assert_list_9.Result,
    FlattenInputs=True)  # -> flatten(Result)
entwine_8 = Entwine(
    Branch00=assert_17.Result,
    Branch01=assert_list_6.Result,
    Branch02=assert_point_list_15.Result,
    Branch03=assert_point_list_16.Result,
    Branch04=assert_list_7.Result,
    FlattenInputs=True)  # -> flatten(Result)
entwine_9 = Entwine(Branch00=entwine_6, Branch01=entwine_4, Branch02=entwine_7, Branch03=entwine_5, Branch04=entwine_8, FlattenInputs=True)  # -> flatten(Result)

# ----
# Mesh To Graph
pt_41 = Point(Point(10, 10, 0))
pt_42 = Point(Point(0, 10, 0))
pt_43 = Point(Point(0, 0, 0))
pt_44 = Point(Point(10, 0, 0))
face = MeshFace({A=0, B=1, C=2, D=3})
pt_45 = Point(Point(10, 10, 0))
pt_46 = Point(Point(0, 0, 0))
pt_47 = Point(Point(10, 0, 0))
face_2 = MeshFace({A=0, B=2, C=1, D=1})
pt_48 = Point(Point(10, 10, 0))
pt_49 = Point(Point(0, 10, 0))
pt_50 = Point(Point(0, 0, 0))
pt_51 = Point(Point(10, 0, 0))
face_3 = MeshFace({A=0, B=2, C=1, D=1})
face_4 = MeshFace({A=0, B=3, C=2, D=2})
conmesh = ConstructMesh(Vertices=[pt_43, pt_44, pt_41, pt_42], Faces=face)
conmesh_2 = ConstructMesh(Vertices=[pt_46, pt_47, pt_45], Faces=face_2)
pt_52 = Point([Point(7.608514279, 2.629216732, 0), Point(-3.344938733, 10.66174894, 0), Point(8.33874448, 21.90729403, 0), Point(19.29219749, 20.59287967, 0), Point(30.6107656, 8.836173438, 0), Point(29.07728218, 1.38782539, 0), Point(17.39359897, -8.762374401, 0), Point(2.423879854, -8.10516722, 0)])
conmesh_3 = ConstructMesh(Vertices=[pt_50, pt_51, pt_48, pt_49], Faces=[face_3, face_4])
number_slider_5 = Slider(5, range=0..110)
mesh_to_graph = MeshToGraph(Mesh=conmesh)
nurbs_5 = NurbsCurve(Vertices=pt_52, Degree=3, Periodic=True)  # -> Curve, Length, Domain
mesh_to_graph_2 = MeshToGraph(Mesh=conmesh_2)
mesh_to_graph_3 = MeshToGraph(Mesh=conmesh_3)
boundary = BoundarySurfaces(Edges=nurbs_5.Curve)
deconstruct_graph_6 = DeconstructGraph(Graph=mesh_to_graph)  # -> GraphArray, Vertices, Edges, AdjacencyList
crv_10 = Curve(deconstruct_graph_6.Edges)
deconstruct_graph_7 = DeconstructGraph(Graph=mesh_to_graph_2)  # -> GraphArray, Vertices, Edges, AdjacencyList
panel_20 = Panel(deconstruct_graph_6.AdjacencyList)
crv_11 = Curve(deconstruct_graph_7.Edges)
panel_21 = Panel(deconstruct_graph_7.AdjacencyList)
deconstruct_graph_8 = DeconstructGraph(Graph=mesh_to_graph_3)  # -> GraphArray, Vertices, Edges, AdjacencyList
crv_12 = Curve(deconstruct_graph_8.Edges)
divide_10 = DivideCurve(Curve=crv_10, Count=10, Kinks=False)  # -> flatten(Points), Tangents, Parameters
mesh_uv = MeshSurface(Surface=boundary, UCount=number_slider_5, VCount=number_slider_5, Overhang=True, Equalize=False)
panel_22 = Panel(deconstruct_graph_8.AdjacencyList)
divide_11 = DivideCurve(Curve=crv_11, Count=10, Kinks=False)  # -> flatten(Points), Tangents, Parameters
txt_20 = Text("""Graph
Vertices: 4
Edges: 8""")
panel_23 = Panel(deconstruct_graph_6.GraphArray)
txt_21 = Text(["0;1", "1;0", "0;3", "3;0", "1;2", "2;1", "2;3", "3;2"])
divide_12 = DivideCurve(Curve=crv_12, Count=10, Kinks=False)  # -> flatten(Points), Tangents, Parameters
txt_22 = Text(["1;3;", "0;2;", "1;3;", "0;2;"])
txt_23 = Text("""Graph
Vertices: 3
Edges: 6""")
pt_53 = Point([Point(0, 0, 0), Point(10, 0, 0), Point(10, 10, 0), Point(0, 10, 0)])
panel_24 = Panel(deconstruct_graph_7.GraphArray)
txt_24 = Text(["0;1", "1;0", "0;2", "2;0", "1;2", "2;1"])
pt_54 = Point([Point(0, 0, 0), Point(1, 0, 0), Point(2, 0, 0), Point(3, 0, 0), Point(4, 0, 0), Point(5, 0, 0)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])
txt_25 = Text(["1;2;", "0;2;", "0;1;"])
pt_55 = Point([Point(0, 0, 0), Point(10, 0, 0), Point(10, 10, 0)])
txt_26 = Text("""Graph
Vertices: 4
Edges: 10""")
panel_25 = Panel(deconstruct_graph_8.GraphArray)
txt_27 = Text(["0;1", "1;0", "0;2", "2;0", "0;3", "3;0", "1;2", "2;1", "2;3", "3;2"])
pt_56 = Point([Point(0, 0, 0), Point(1, 0, 0), Point(2, 0, 0), Point(3, 0, 0), Point(4, 0, 0), Point(5, 0, 0)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])
mesh_to_graph_4 = MeshToGraph(Mesh=mesh_uv)
deconstruct_graph_9 = DeconstructGraph(Graph=mesh_to_graph_4)  # -> GraphArray, Vertices, Edges, AdjacencyList
crv_13 = Curve(deconstruct_graph_9.Edges)
txt_28 = Text(["1;2;3;", "0;2;", "0;1;3;", "0;2;"])
assert_18 = Assert(TestNames="CreateGraphMilimeters_1FaceQuad_String", Expected=txt_20, Actual=mesh_to_graph)  # -> Result, FailedInfo
panel_26 = Panel(deconstruct_graph_9.AdjacencyList)
pt_57 = Point([Point(0, 0, 0), Point(10, 0, 0), Point(10, 10, 0), Point(0, 10, 0)])
pt_58 = Point([Point(0, 0, 0), Point(1, 0, 0), Point(2, 0, 0), Point(3, 0, 0), Point(4, 0, 0), Point(5, 0, 0)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])
assert_list_10 = AssertList(TestName="CreateGraphMilimeters_1FaceQuad_GraphArray", ExpectedList=txt_21, ActualList=panel_23)  # -> Result, FailedInfo
assert_19 = Assert(TestNames="CreateGraphMilimeters_1FaceTri_String", Expected=txt_23, Actual=mesh_to_graph_2)  # -> Result, FailedInfo
assert_point_list_19 = AssertPointList(
    TestName="CreateGraphMilimeters_1FaceQuad_Edge",
    ExpectedPointList=pt_54,
    ActualPointList=divide_10.Points,
    Tolerance="0.0001")  # -> Result, FailedInfo
assert_point_list_20 = AssertPointList(
    TestName="CreateGraphMilimeters_1FaceQuad_Vertices",
    ExpectedPointList=pt_53,
    ActualPointList=deconstruct_graph_6.Vertices,
    Tolerance="0.0001")  # -> Result, FailedInfo
assert_list_11 = AssertList(TestName="CreateGraphMilimeters_1FaceQuad_AdjacencyList", ExpectedList=txt_22, ActualList=panel_20)  # -> Result, FailedInfo
divide_13 = DivideCurve(Curve=crv_13, Count=10, Kinks=False)  # -> flatten(Points), Tangents, Parameters
assert_list_12 = AssertList(TestName="CreateGraphMilimeters_1FaceTri_GraphArray", ExpectedList=txt_24, ActualList=panel_24)  # -> Result, FailedInfo
assert_point_list_21 = AssertPointList(
    TestName="CreateGraphMilimeters_1FaceTri_Edge",
    ExpectedPointList=pt_56,
    ActualPointList=divide_11.Points,
    Tolerance="0.0001")  # -> Result, FailedInfo
assert_point_list_22 = AssertPointList(
    TestName="CreateGraphMilimeters_1FaceTri_Vertices",
    ExpectedPointList=pt_55,
    ActualPointList=deconstruct_graph_7.Vertices,
    Tolerance="0.0001")  # -> Result, FailedInfo
assert_list_13 = AssertList(TestName="CreateGraphMilimeters_1FaceTri_AdjacencyList", ExpectedList=txt_25, ActualList=panel_21)  # -> Result, FailedInfo
assert_20 = Assert(TestNames="CreateGraphMilimeters_2FaceTri_String", Expected=txt_26, Actual=mesh_to_graph_3)  # -> Result, FailedInfo
assert_list_14 = AssertList(TestName="CreateGraphMilimeters_2FaceTri_GraphArray", ExpectedList=txt_27, ActualList=panel_25)  # -> Result, FailedInfo
assert_point_list_23 = AssertPointList(
    TestName="CreateGraphMilimeters_2FaceTri_Edge",
    ExpectedPointList=pt_58,
    ActualPointList=divide_12.Points,
    Tolerance="0.0001")  # -> Result, FailedInfo
assert_point_list_24 = AssertPointList(
    TestName="CreateGraphMilimeters_2FaceTri_Vertices",
    ExpectedPointList=pt_57,
    ActualPointList=deconstruct_graph_8.Vertices,
    Tolerance="0.0001")  # -> Result, FailedInfo
assert_list_15 = AssertList(TestName="CreateGraphMilimeters_2FaceTri_AdjacencyList", ExpectedList=txt_28, ActualList=panel_22)  # -> Result, FailedInfo
txt_29 = Text("""Graph
Vertices: 34
Edges: 112""")
panel_27 = Panel(deconstruct_graph_9.GraphArray)
txt_30 = Text(["0;1", "1;0", "0;6", "6;0", "1;2", "2;1", "1;7", "7;1", "2;3", "3;2"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])
pt_59 = Point([Point(0.008278349409, 21.76928052, 0), Point(0.008278349409, 15.64673843, 0), Point(0.008278349409, 9.524196334, 0), Point(0.008278349409, 3.401654238, 0), Point(0.008278349409, -2.720887857, 0), Point(0.008278349409, -8.843429953, 0)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])
txt_31 = Text(["1;6;", "0;2;7;", "1;3;8;", "2;4;9;", "3;5;10;", "4;11;", "0;7;12;", "1;6;8;13;", "2;7;9;14;", "3;8;10;15;", "4;9;11;16;", "5;10;17;", "6;13;18;", "7;12;14;19;", "8;13;15;20;", "9;14;16;21;", "10;15;17;22;", "11;16;23;", "12;19;24;", "13;18;20;25;", "14;19;21;26;", "15;20;22;27;", "16;21;23;28;", "17;22;29;", "18;25;", "19;24;26;30;", "20;25;27;31;", "21;26;28;32;", "22;27;29;33;", "23;28;", "25;31;", "26;30;32;", "27;31;33;", "28;32;"])
pt_60 = Point([Point(0.008278349409, 21.76928052, 0), Point(0.008278349409, 21.15702632, 0), Point(0.008278349409, 20.54477211, 0), Point(0.008278349409, 19.9325179, 0), Point(0.008278349409, 19.32026369, 0), Point(0.008278349409, 18.70800948, 0)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])
assert_21 = Assert(TestNames="CreateGraphMilimeters_SurfaceToMesh_String", Expected=txt_29, Actual=mesh_to_graph_4)  # -> Result, FailedInfo
assert_list_16 = AssertList(TestName="CreateGraphMilimeters_SurfaceToMesh_GraphArray", ExpectedList=txt_30, ActualList=panel_27)  # -> Result, FailedInfo
assert_point_list_25 = AssertPointList(
    TestName="CreateGraphMilimeters_SurfaceToMesh_Edge",
    ExpectedPointList=pt_60,
    ActualPointList=divide_13.Points,
    Tolerance="0.0001")  # -> Result, FailedInfo
assert_point_list_26 = AssertPointList(
    TestName="CreateGraphMilimeters_SurfaceToMesh_Vertices",
    ExpectedPointList=pt_59,
    ActualPointList=deconstruct_graph_9.Vertices,
    Tolerance="0.0001")  # -> Result, FailedInfo
assert_list_17 = AssertList(TestName="CreateGraphMilimeters_SurfaceToMesh_AdjacencyList", ExpectedList=txt_31, ActualList=panel_26)  # -> Result, FailedInfo
entwine_10 = Entwine(
    Branch00=assert_18.Result,
    Branch01=assert_list_10.Result,
    Branch02=assert_point_list_20.Result,
    Branch03=assert_point_list_19.Result,
    Branch04=assert_list_11.Result,
    FlattenInputs=True)  # -> flatten(Result)
entwine_11 = Entwine(
    Branch00=assert_19.Result,
    Branch01=assert_list_12.Result,
    Branch02=assert_point_list_22.Result,
    Branch03=assert_point_list_21.Result,
    Branch04=assert_list_13.Result,
    FlattenInputs=True)  # -> flatten(Result)
entwine_12 = Entwine(
    Branch00=assert_20.Result,
    Branch01=assert_list_14.Result,
    Branch02=assert_point_list_24.Result,
    Branch03=assert_point_list_23.Result,
    Branch04=assert_list_15.Result,
    FlattenInputs=True)  # -> flatten(Result)
entwine_13 = Entwine(
    Branch00=assert_21.Result,
    Branch01=assert_list_16.Result,
    Branch02=assert_point_list_26.Result,
    Branch03=assert_point_list_25.Result,
    Branch04=assert_list_17.Result,
    FlattenInputs=True)  # -> flatten(Result)
entwine_14 = Entwine(Branch00=entwine_10, Branch01=entwine_11, Branch02=entwine_12, Branch03=entwine_13, FlattenInputs=True)  # -> flatten(Result)

# ----
# Graph To Report Part
number_slider_6 = Slider(10, range=0..10)
panel_28 = Panel("GraphToReportPartMilimeters_1GraphPartDirectionTrueShowWeightsTrue_ReportPart")
panel_29 = Panel("GraphToReportPartMilimeters_1GraphPartDirectionFalseShowWeightsTrue_ReportPart")
panel_30 = Panel("GraphToReportPartMilimeters_1GraphPartDirectionFalseShowWeightsFalse_ReportPart")
pt_61 = ConstructPoint(XCoordinate=0, YCoordinate=0, ZCoordinate=0)
pt_62 = ConstructPoint(XCoordinate=number_slider_6, YCoordinate=0, ZCoordinate=0)
pt_63 = ConstructPoint(XCoordinate=0, YCoordinate=0, ZCoordinate=0)
pt_64 = ConstructPoint(XCoordinate=Slider(10, range=0..10), YCoordinate=0, ZCoordinate=0)
pt_65 = ConstructPoint(XCoordinate=0, YCoordinate=0, ZCoordinate=0)
pt_66 = ConstructPoint(XCoordinate=Slider(10, range=0..10), YCoordinate=0, ZCoordinate=0)
panel_31 = Panel("GraphToReportPartMilimeters_1GraphPartUndirectedDirectionTrueShowWeightsTrue_ReportPart")
panel_32 = Panel("GraphToReportPartMilimeters_1GraphPartDirectionFalseShowWeightsTrue_TextFormat")
pt_67 = ConstructPoint(XCoordinate=0, YCoordinate=0, ZCoordinate=0)
pt_68 = ConstructPoint(XCoordinate=Slider(10, range=0..10), YCoordinate=0, ZCoordinate=0)
panel_33 = Panel("GraphToReportPartMilimeters_TriangleDirectionTrueShowWeightsTrue_ReportPart")
panel_34 = Panel("GraphToReportPartMilimeters_TriangleDirectionFalseShowWeightsTrue_ReportPart")
pt_69 = ConstructPoint(XCoordinate=0, YCoordinate=0, ZCoordinate=0)
pt_70 = ConstructPoint(XCoordinate=Slider(10, range=0..10), YCoordinate=0, ZCoordinate=0)
two_points_to_graph_part_12 = TwoPointsToGraphPart(PointA=pt_61, PointB=pt_62, IsDirected=Toggle(True))
two_points_to_graph_part_13 = TwoPointsToGraphPart(PointA=pt_63, PointB=pt_64, IsDirected=Toggle(True))
two_points_to_graph_part_14 = TwoPointsToGraphPart(PointA=pt_65, PointB=pt_66, IsDirected=Toggle(True))
toggle_4 = BooleanToggle(True)
toggle_5 = BooleanToggle(True)
pt_71 = ConstructPoint(XCoordinate=0, YCoordinate=0, ZCoordinate=0)
pt_72 = ConstructPoint(XCoordinate=Slider(10, range=0..10), YCoordinate=0, ZCoordinate=0)
pt_73 = ConstructPoint(XCoordinate=0, YCoordinate=0, ZCoordinate=0)
pt_74 = ConstructPoint(XCoordinate=Slider(5, range=0..10), YCoordinate=Slider(5, range=0..10), ZCoordinate=0)
pt_75 = ConstructPoint(XCoordinate=0, YCoordinate=0, ZCoordinate=0)
pt_76 = ConstructPoint(XCoordinate=Slider(10, range=0..10), YCoordinate=0, ZCoordinate=0)
pt_77 = ConstructPoint(XCoordinate=0, YCoordinate=0, ZCoordinate=0)
pt_78 = ConstructPoint(XCoordinate=Slider(5, range=0..10), YCoordinate=Slider(5, range=0..10), ZCoordinate=0)
two_points_to_graph_part_15 = TwoPointsToGraphPart(PointA=pt_67, PointB=pt_68, IsDirected=Toggle(True))
two_points_to_graph_part_16 = TwoPointsToGraphPart(PointA=pt_69, PointB=pt_70, IsDirected=Toggle(False))
two_points_to_graph_part_17 = TwoPointsToGraphPart(PointA=pt_73, PointB=pt_74, IsDirected=toggle_4)
two_points_to_graph_part_18 = TwoPointsToGraphPart(PointA=pt_72, PointB=pt_74, IsDirected=toggle_4)
two_points_to_graph_part_19 = TwoPointsToGraphPart(PointA=pt_71, PointB=pt_72, IsDirected=toggle_4)
two_points_to_graph_part_20 = TwoPointsToGraphPart(PointA=pt_77, PointB=pt_78, IsDirected=toggle_5)
two_points_to_graph_part_21 = TwoPointsToGraphPart(PointA=pt_76, PointB=pt_78, IsDirected=toggle_5)
two_points_to_graph_part_22 = TwoPointsToGraphPart(PointA=pt_75, PointB=pt_76, IsDirected=toggle_5)
create_graph_6 = CreateGraph(GraphParts=two_points_to_graph_part_12, Tolerance=0.0001)
create_graph_7 = CreateGraph(GraphParts=two_points_to_graph_part_13, Tolerance=0.0001)
create_graph_8 = CreateGraph(GraphParts=two_points_to_graph_part_14, Tolerance=0.0001)
create_graph_9 = CreateGraph(GraphParts=two_points_to_graph_part_15, Tolerance=0.0001)
create_graph_10 = CreateGraph(GraphParts=two_points_to_graph_part_16, Tolerance=0.0001)
graph_to_report_part = GraphToReportPart(Graph=create_graph_7, Direction=Toggle(False), ShowWeights=Toggle(True), TextFormat="{0:0.00}")
graph_to_report_part_2 = GraphToReportPart(Graph=create_graph_8, Direction=Toggle(False), ShowWeights=Toggle(False), TextFormat="{0:0.00}")
graph_to_report_part_3 = GraphToReportPart(Graph=create_graph_6, Direction=Toggle(True), ShowWeights=Toggle(True), TextFormat="{0:0.00}")
create_graph_11 = CreateGraph(GraphParts=[two_points_to_graph_part_19, two_points_to_graph_part_17, two_points_to_graph_part_18], Tolerance=0.0001)
create_graph_12 = CreateGraph(GraphParts=[two_points_to_graph_part_22, two_points_to_graph_part_20, two_points_to_graph_part_21], Tolerance=0.0001)
graph_to_report_part_4 = GraphToReportPart(Graph=create_graph_9, Direction=Toggle(False), ShowWeights=Toggle(True), TextFormat="{0:0.0000}")
txt_32 = Text("""```mermaid
graph LR
0--10.00-->1;
```""")
txt_33 = Text("""```mermaid
graph TD
0--10.00-->1;
```""")
graph_to_report_part_5 = GraphToReportPart(Graph=create_graph_10, Direction=Toggle(True), ShowWeights=Toggle(True), TextFormat="{0:0.00}")
txt_34 = Text("""```mermaid
graph TD
0-->1;
```""")
txt_35 = Text("""```mermaid
graph TD
0--10.0000-->1;
```""")
graph_to_report_part_6 = GraphToReportPart(Graph=create_graph_11, Direction=Toggle(True), ShowWeights=Toggle(True), TextFormat="{0:0.00}")
txt_36 = Text("""```mermaid
graph LR
0--10.00-->1;
1--10.00-->0;
```""")
graph_to_report_part_7 = GraphToReportPart(Graph=create_graph_12, Direction=Toggle(False), ShowWeights=Toggle(True), TextFormat="{0:0.00}")
assert_22 = Assert(TestNames=panel_28, Expected=txt_32, Actual=graph_to_report_part_3)  # -> Result, FailedInfo
assert_23 = Assert(TestNames=panel_29, Expected=txt_33, Actual=graph_to_report_part)  # -> Result, FailedInfo
assert_24 = Assert(TestNames=panel_30, Expected=txt_34, Actual=graph_to_report_part_2)  # -> Result, FailedInfo
txt_37 = Text("""```mermaid
graph LR
0--10.00-->1;
0--7.07-->2;
1--7.07-->2;
```""")
txt_38 = Text("""```mermaid
graph TD
0--10.00-->1;
0--7.07-->2;
1--7.07-->2;
```""")
assert_25 = Assert(TestNames=panel_32, Expected=txt_35, Actual=graph_to_report_part_4)  # -> Result, FailedInfo
assert_26 = Assert(TestNames=panel_31, Expected=txt_36, Actual=graph_to_report_part_5)  # -> Result, FailedInfo
assert_27 = Assert(TestNames=panel_33, Expected=txt_37, Actual=graph_to_report_part_6)  # -> Result, FailedInfo
assert_28 = Assert(TestNames=panel_34, Expected=txt_38, Actual=graph_to_report_part_7)  # -> Result, FailedInfo
entwine_15 = Entwine(
    Branch00=assert_22.Result,
    Branch01=assert_23.Result,
    Branch02=assert_24.Result,
    Branch03=assert_25.Result,
    Branch04=assert_26.Result,
    Branch05=assert_27.Result,
    Branch06=assert_28.Result,
    FlattenInputs=True)  # -> flatten(Result)

# ----
# Result:
total = Total(Results=flatten([entwine_3, entwine_2, entwine, entwine_9, entwine_14, entwine_15]))  # -> TotalResult, ReportPart
panel_35 = Panel(total.TotalResult)

# ----
# Export report:
# Table of contents:
# Curve To Graph Part
# Two Points To Graph Part
# Vector To Graph Part
# Create Graph
# Mesh To Graph
# Graph To Report Part
create_report = CreateReport(ReportParts=[calendar, total.ReportPart], TableOfContents=False)
path = FilePath("C:\Users\code-structures\Desktop\Projekty\2020_12_03_Megarachne\Megarachne\Megarachne\Megarachne\TestsInsideGrasshopper\Report.md")  # disabled
# Unit Tests inside Grasshopper
# 
# Required plugins:
# - Megarachne
# - Pterodactyl
# - Brontosaurus
save_report = SaveReport(Report=create_report, Path=path)  # disabled

pt_79 = Point([Point(7.608514279, 2.629216732, 0), Point(-3.344938733, 10.66174894, 0), Point(8.33874448, 21.90729403, 0), Point(19.29219749, 20.59287967, 0), Point(30.6107656, 8.836173438, 0), Point(29.07728218, 1.38782539, 0), Point(17.39359897, -8.762374401, 0), Point(2.423879854, -8.10516722, 0)])
number_slider_7 = Slider(5, range=0..110)
nurbs_6 = NurbsCurve(Vertices=pt_79, Degree=3, Periodic=True)  # -> Curve, Length, Domain
panel_36 = Panel("GraphToReportPartMilimeters_Mesh_TooManyEdgesException")
boundary_2 = BoundarySurfaces(Edges=nurbs_6.Curve)
mesh_uv_2 = MeshSurface(Surface=boundary_2, UCount=number_slider_7, VCount=number_slider_7, Overhang=True, Equalize=False)
mesh_to_graph_5 = MeshToGraph(Mesh=mesh_uv_2)
graph_to_report_part_8 = GraphToReportPart(Graph=mesh_to_graph_5, Direction=True, ShowWeights=True, TextFormat="{0:0.00}")
